# Dynamo graph 01_Analytical Model Creation.dyn (Dynamo 2.16.1.2727)
# packages: Clockwork for Dynamo 2.x 2.4.0, spring nodes 210.1.1, Rhythm 2023.4.2024, archi-lab.net 2023.213.1722, Structural Design 2022.12.15, Synthesize toolkit 12.7.5

explode = Geometry.Explode()  # frozen; unwired: geometry
area = Surface.Area(surface=explode)
sortByKey = List.SortByKey(list=explode@L2, keys=area@L2)
code_block = CodeBlock { 2; }
takeItems = List.TakeItems(list=sortByKey.sortedList@L2, amount=code_block)
code_block_2 = CodeBlock { 0.5; }
pointAtParameter = Surface.PointAtParameter(surface=takeItems, u=code_block_2, v=code_block_2)
code_block_3 = CodeBlock(t4=pointAtParameter)
# ---------- code_block_3.designscript (8 lines) ----------
po = t4;
pr = 1;
a = [po.X, po.Y, po.Z];
ar = (Math.Round(a / pr)) * pr;
t1 = Get.ValueAtIndex(ar, 0);
t2 = Get.ValueAtIndex(ar, 1);
t3 = Get.ValueAtIndex(ar, 2);
point1 = Point.ByCoordinates(t1, t2, t3);
# ----------------------------------------
code_block_4 = CodeBlock(p=code_block_3.point1) { List.GetItemAtIndex(p<2>,0); List.GetItemAtIndex(p<2>,1); }
byStartPointEndPoint = Line.ByStartPointEndPoint(startPoint=code_block_4.out0@L2, endPoint=code_block_4.out1@L2)
code_block_5 = CodeBlock { a; }  # frozen; unwired: a
edges = Topology.Edges(topology=code_block_5)
curveGeometry = Edge.CurveGeometry(edge=edges)
length = Curve.Length(curve=curveGeometry)
sortByKey_2 = List.SortByKey(list=curveGeometry@L2, keys=length@L2)
lastItem = List.LastItem(list=sortByKey_2.sortedList@L2)
coordinateSystemAtParameter = Curve.CoordinateSystemAtParameter(curve=lastItem)
identity = CoordinateSystem.Identity()
transform = Geometry.Transform(geometry=code_block_5@L2, fromCoordinateSystem=coordinateSystemAtParameter@L2, contextCoordinateSystem=identity)
byGeometry = BoundingBox.ByGeometry(geom=transform@L1)
toCuboid = BoundingBox.ToCuboid(boundingBox=byGeometry@L2)
transform_2 = Geometry.Transform(geometry=toCuboid@L2, fromCoordinateSystem=identity, contextCoordinateSystem=coordinateSystemAtParameter@L2)
code_block_6 = CodeBlock()
# ---------- code_block_6.designscript (13 lines) ----------
def CenterLine(gmt)
{
	geometry1 = Autodesk.Geometry.Explode(gmt);
	num3 = Autodesk.Surface.Area(geometry1);
	t4 = Dictionary.ValueAtKey(List.SortByKey(geometry1@L2<1>, num3@L2<1>), "sortedList");
	t5 = List.TakeItems(t4@L2<1>, 2);
	p2 = Autodesk.Surface.PointAtParameter(t5, 0.5, 0.5);
	a = [p2.X, p2.Y, p2.Z];
	ar = (Math.Round(a / 1)) * 1;
	p = Point.ByCoordinates(Get.ValueAtIndex(ar, 0), Get.ValueAtIndex(ar, 1), Get.ValueAtIndex(ar, 2));
	line1 = Line.ByStartPointEndPoint(List.GetItemAtIndex(p<2>, 0), List.GetItemAtIndex(p<2>, 1));
	return = line1;
};
# ----------------------------------------
code_block_7 = CodeBlock()
# ---------- code_block_7.designscript (15 lines) ----------
def UnalignedCuboid(solid1)
{
	edge1 = Topology.Edges(solid1);
	curve1 = Edge.CurveGeometry(edge1);
	num1 = Autodesk.Curve.Length(curve1);
	t2 = Dictionary.ValueAtKey(List.SortByKey(curve1@L2<1>, num1@L2<1>), "sortedList");
	t4 = List.LastItem(t2@L2<1>);
	coordinate1 = Autodesk.Curve.CoordinateSystemAtParameter(t4, 0);
	coordinate2 = CoordinateSystem.Identity();
	geometry1 = Autodesk.Geometry.Transform(solid1@L2<1>, coordinate1@L2<1>, coordinate2);
	boundingBox1 = Autodesk.Geometry.BoundingBox.ByGeometry(geometry1@L1<1>);
	cuboid1 = Autodesk.Geometry.BoundingBox.ToCuboid(boundingBox1@L2<1>);
	geometry2 = Autodesk.Geometry.Transform(cuboid1@L2<1>, coordinate2, coordinate1@L2<1>);
	return = geometry2;
};
# ----------------------------------------
vertexPositions = Mesh.VertexPositions()  # frozen; unwired: mesh
Z = Point.Z(point=vertexPositions)
sortByKey_3 = List.SortByKey(list=vertexPositions@L2, keys=Z@L2)
code_block_8 = CodeBlock { 4; }
takeItems_2 = List.TakeItems(list=sortByKey_3.sortedList@L2, amount=code_block_8)
ʳʰʸᵗʰᵐ_convexhull_frompoints = Rhythm.Geometry.Tessellation.ConvexHull.FromPoints(points=takeItems_2)
byPatch = Surface.ByPatch(closedCurve=ʳʰʸᵗʰᵐ_convexhull_frompoints)
code_block_9 = CodeBlock(a=sortByKey_3.sortedKeys) { List.LastItem(a<2>)-List.FirstItem(a<2>); }
boolean = BoolSelector(false)
thicken = Surface.Thicken(surface=byPatch, thickness=code_block_9, both_sides=boolean)
code_block_10 = CodeBlock()
# ---------- code_block_10.designscript (12 lines) ----------
def MeshToCubid(msh)
{
	point1 = Point.PruneDuplicates(Mesh.VertexPositions(msh), 10);
	num2 = Point.Z(point1);
	t3 = List.SortByKey(point1@L2<1>, num2@L2<1>);
	t4 = Dictionary.ValueAtKey(t3, "sortedList");
	t5 = Dictionary.ValueAtKey(t3, "sortedKeys");
	polyCurve1 = Rhythm.ConvexHull.FromPoints(List.TakeItems(t4@L2<1>, 4));
	surface1 = Autodesk.Surface.ByPatch(polyCurve1);
	solid1 = Autodesk.Surface.Thicken(surface1, (List.LastItem(t5<2>)) - (List.FirstItem(t5<2>)), false);
	return = solid1;
};
# ----------------------------------------
code_block_11 = CodeBlock()
# ---------- code_block_11.designscript (22 lines) ----------
def AglinCoordX(p:Point[],m)
{
	cor = Point.X(p);
	n = Math.Round(cor);
	n1 = n - m/2;
	n2 = n + m/2;
	b1 = n >= n1<2>;
	b2 = n < n2<2>;
	bol = b1 && b2;
	b3 = true;
	i = List.IndexOf(bol@L2<1>, b3);
	t3 = List.GroupByKey(p, i);
	t4 = Dictionary.ValueAtKey(t3, "groups");
	num4 = Point.Z(t4);
	t6 = List.SortByKey(t4@L2<1>, num4@L2<1>);
	t7 = Dictionary.ValueAtKey(t6, "sortedList");
	num1 = Point.X(List.FirstItem(t7@L2<1>));
	num7 = List.Count(num1);
	t9 = List.Cycle(num1, num7);
	point1 = Point.ByCoordinates(t9, Point.Y(t7), Point.Z(t7));
	return = point1;
};
# ----------------------------------------
code_block_12 = CodeBlock()
# ---------- code_block_12.designscript (22 lines) ----------
def AglinCoordY(p:Point[],m)
{
	cor = Point.Y(p);
	n = Math.Round(cor);
	n1 = n - m/2;
	n2 = n + m/2;
	b1 = n >= n1<2>;
	b2 = n < n2<2>;
	bol = b1 && b2;
	b3 = true;
	i = List.IndexOf(bol@L2<1>, b3);
	t3 = List.GroupByKey(p, i);
	t4 = Dictionary.ValueAtKey(t3, "groups");
	num4 = Point.Z(t4);
	t6 = List.SortByKey(t4@L2<1>, num4@L2<1>);
	t7 = Dictionary.ValueAtKey(t6, "sortedList");
	num1 = Point.Y(List.FirstItem(t7@L2<1>));
	num7 = List.Count(num1);
	t9 = List.Cycle(num1, num7);
	point1 = Point.ByCoordinates(Point.X(t7), t9, Point.Z(t7));
	return = point1;
};
# ----------------------------------------
code_block_13 = CodeBlock()
# ---------- code_block_13.designscript (19 lines) ----------
def TransferredLine(lin:Line[], pnt:Point[], mar)
{
	p1=Line.StartPoint(lin);
	p2=Line.EndPoint(lin);
	num1 = Autodesk.Geometry.DistanceTo(p1<1>, pnt<2>);
	t3 = List.MinimumItem(num1);
	t4 = List.AllIndicesOf(num1@L2<1>, t3@L1<1>);
	a1 = List.FirstItem(t4@L2<1>);
	t5 = List.GetItemAtIndex(pnt, a1);
	t6 = t3<mar?t5:p1;
	num2 = Autodesk.Geometry.DistanceTo(p2<1>, pnt<2>);
	t7 = List.MinimumItem(num2);
	t8 = List.AllIndicesOf(num2@L2<1>, t7@L1<1>);
	a2 = List.FirstItem(t8@L2<1>);
	t9 = List.GetItemAtIndex(pnt, a2);
	t10 = t7<mar?t9:p2;
	line1 = Line.ByStartPointEndPoint(t6, t10);
	return line1;
};
# ----------------------------------------
code_block_14 = CodeBlock { lin; }  # frozen; unwired: lin
code_block_15 = CodeBlock(a=code_block_14) { Line.StartPoint(a); }
code_block_16 = CodeBlock { pnt; }  # frozen; unwired: pnt
distanceTo = Geometry.DistanceTo(geometry=code_block_15, other=code_block_16, lacing=CrossProduct)
minimumItem = List.MinimumItem(list=distanceTo)
allIndicesOf = List.AllIndicesOf(list=distanceTo@L2, item=minimumItem@L1)
firstItem = List.FirstItem(list=allIndicesOf@L2)
getItemAtIndex = List.GetItemAtIndex(list=code_block_16, index=firstItem)
code_block_17 = CodeBlock(a=minimumItem, p1=getItemAtIndex, p2=code_block_15) { a<100?p1:p2; }
code_block_18 = CodeBlock(a=code_block_14) { Line.EndPoint(a); }
distanceTo_2 = Geometry.DistanceTo(geometry=code_block_18, other=code_block_16, lacing=CrossProduct)
minimumItem_2 = List.MinimumItem(list=distanceTo_2)
allIndicesOf_2 = List.AllIndicesOf(list=distanceTo_2@L2, item=minimumItem_2@L1)
firstItem_2 = List.FirstItem(list=allIndicesOf_2@L2)
getItemAtIndex_2 = List.GetItemAtIndex(list=code_block_16, index=firstItem_2)
code_block_19 = CodeBlock(a=minimumItem_2, p1=getItemAtIndex_2, p2=code_block_18) { a<100?p1:p2; }
byStartPointEndPoint_2 = Line.ByStartPointEndPoint(startPoint=code_block_17, endPoint=code_block_19)
code_block_20 = CodeBlock()
# ---------- code_block_20.designscript (19 lines) ----------
def AglinCoordZ(p:Point[],m)
{
	cor = Point.Z(p);
	n = Math.Round(cor);
	n1 = n - m/2;
	n2 = n + m/2;
	b1 = n >= n1<2>;
	b2 = n < n2<2>;
	bol = b1 && b2;
	b3 = true;
	i = List.IndexOf(bol@L2<1>, b3);
	t3 = List.GroupByKey(p, i);
	t4 = Dictionary.ValueAtKey(t3, "groups");
	num4 = Math.Round(Math.Average(Point.Z(t4)));
	num7 = List.Count(t4@L2<1>);
	t9 = List.Cycle(num4@L1<1>, num7@L1<1>);
	point1 = Point.ByCoordinates(Point.X(t4), Point.Y(t4), t9);
	return = point1;
};
# ----------------------------------------
code_block_21 = CodeBlock()
# ---------- code_block_21.designscript (15 lines) ----------
def NearNumber(dd:var[],tt:var[])
{
t5 = dd / 2;
t2 = dd + t5;
t6 = (tt<1>) < t2;
t4 = dd- t5;
t7 = (tt<1>) > t4;
bool1 = (t6 == true) && (t7 == true);
t8 = true;
num2 = List.IndexOf(bool1@L2<1>, t8);
t9 = List.GetItemAtIndex(dd, num2);
t1 = List.MaximumItem(dd);
t10 = Lists.ReplaceNull(t9, t1);
return = t10;
};
# ----------------------------------------
allIndicesOf_3 = List.AllIndicesOf()  # unwired: list, item
categories = Categories("OST_StructuralFraming")
views = Views("Work view")
all_elements_of_category_in_view = ElementsOfCategoryInView(Category=categories, View=views)

# group: FLOORS
code_block_22 = CodeBlock(e=all_elements_of_category_in_view) { e; }
code_block_23 = CodeBlock { "Sublabel2(Data)"; "FLOORS"; }
getParameterValueByName = Element.GetParameterValueByName(element=code_block_22, parameterName=code_block_23.out0)
eq = getParameterValueByName == code_block_23.out1
filterByBoolMask = List.FilterByBoolMask(list=code_block_22, mask=eq)
flatten = List.Flatten(list=filterByBoolMask.in)
geometry = Element.Geometry(element=flatten)
flatten_2 = List.Flatten(list=geometry)
code_block_24 = CodeBlock(a=flatten_2) { String.Contains(DSCore.Object.Type(a), "Mesh", false); }
boolean_2 = BoolSelector(true)
allIndicesOf_4 = List.AllIndicesOf(list=code_block_24, item=boolean_2)
getItemAtIndex_3 = List.GetItemAtIndex(list=flatten_2, index=allIndicesOf_4)
code_block_25 = CodeBlock(msh=getItemAtIndex_3) { List.Flatten(MeshToCubid(msh),-1); }
replaceItemAtIndex = Custom[List.ReplaceItemAtIndex+](seq=flatten_2, indices=allIndicesOf_4, replacement=code_block_25)  # package Clockwork for Dynamo 2.x; Replaces the item at a given index of a list by another item. Unlike the OOTB node, it can replace items at multiple indeces.
list_create = List.Create()  # unwired: item0, item1, item2
boundingBox = Element.BoundingBox(element=flatten)
properties = Custom[BoundingBox.Properties](boundingBox=boundingBox)  # package Clockwork for Dynamo 2.x; Retrieves the centroid, width, depth and height of a given bounding box
combine = List.Combine(combineFunction=list_create, list0=properties.Width, list1=properties.Depth, list2=properties.Height)
ꟿ_list_maxindex = Custom[ꟿ List.MaxIndex](list=combine)  # package spring nodes; Gets the maximum index of a list. Good for use with floating point values
groupByKey = List.GroupByKey(list=replaceItemAtIndex, keys=ꟿ_list_maxindex.idx)
code_block_26 = CodeBlock { 50; }
ꟿ_geometry_groupbydistance = Custom[ꟿ Geometry.GroupByDistance](geometry=groupByKey.groups, margin=code_block_26)  # package spring nodes; Splits the list of geometry elements into groups if the distance between them is less than the provided margin.
byUnion = Solid.ByUnion(solids=ꟿ_geometry_groupbydistance@L2)
code_block_27 = CodeBlock(a=byUnion) { List.Flatten(UnalignedCuboid(a),-1); }
code_block_28 = CodeBlock(gmt=code_block_27) { List.Flatten(CenterLine(gmt),-1); }
code_block_29 = CodeBlock(line1=code_block_28, cub=code_block_27)
# ---------- code_block_29.designscript (7 lines) ----------
t2 = List.Flatten(line1, -1);
num1 = Autodesk.Curve.Length(t2);
t1 = ((num1 < 150 ? true : false));
t3 = List.FilterByBoolMask(t2, t1);
t5 = Dictionary.ValueAtKey(t3, "out");
t6 = List.FilterByBoolMask(cub, t1);
t7 = Dictionary.ValueAtKey(t6, "out");
# ----------------------------------------
direction = Line.Direction(line=code_block_29.t5)
code_block_30 = CodeBlock(a=direction) { Autodesk.Vector.X(a<1>)==0?1:Autodesk.Vector.X(a<1>)==0?2:3; }
groupByKey_2 = List.GroupByKey(list=code_block_29.t5, keys=code_block_30)
code_block_31 = CodeBlock(a=groupByKey_2.groups) { a[1]; }
code_block_32 = CodeBlock(a=groupByKey_2.groups) { a[0]; }
closestPointTo = Geometry.ClosestPointTo(geometry=code_block_32, other=code_block_31, lacing=CrossProduct)
flatten_3 = List.Flatten(list=closestPointTo)
code_block_33 = CodeBlock { 300; }
code_block_34 = CodeBlock(lin=code_block_31, pnt=flatten_3, mar=code_block_33) { TransferredLine(lin, pnt, mar); }
closestPointTo_2 = Geometry.ClosestPointTo(geometry=code_block_34, other=code_block_32, lacing=CrossProduct)
flatten_4 = List.Flatten(list=closestPointTo_2)
code_block_35 = CodeBlock { 300; }
code_block_36 = CodeBlock(lin=code_block_32, pnt=flatten_4, mar=code_block_35) { TransferredLine(lin, pnt, mar); }
code_block_37 = CodeBlock(a=code_block_34, b=code_block_36) { List.Flatten([a,b],-1); }
code_block_38 = CodeBlock { 300; }
code_block_39 = CodeBlock { 300; }

# group: PLATE
code_block_40 = CodeBlock(e=all_elements_of_category_in_view) { e; }
code_block_41 = CodeBlock { "Name(Data)"; }
getParameterValueByName_2 = Element.GetParameterValueByName(element=code_block_40, parameterName=code_block_41)
code_block_42 = CodeBlock { ["BOTTOM PLATE","TOP PLATE","VERY TOP PLATE"]; }
eq_2 = getParameterValueByName_2@L2 == code_block_42  # lacing=CrossProduct
transpose = List.Transpose(lists=eq_2@L3)
anyTrue = List.AnyTrue(list=transpose@L2)
filterByBoolMask_2 = List.FilterByBoolMask(list=code_block_40, mask=anyTrue)
geometry_2 = Element.Geometry(element=filterByBoolMask_2.in)
flatten_5 = List.Flatten(list=geometry_2@L3)
code_block_43 = CodeBlock(a=flatten_5) { String.Contains(DSCore.Object.Type(a), "Mesh", false); }
boolean_3 = BoolSelector(true)
allIndicesOf_5 = List.AllIndicesOf(list=code_block_43, item=boolean_3)
getItemAtIndex_4 = List.GetItemAtIndex(list=flatten_5, index=allIndicesOf_5)
code_block_44 = CodeBlock(msh=getItemAtIndex_4) { List.Flatten(MeshToCubid(msh),-1); }
replaceItemAtIndex_2 = Custom[List.ReplaceItemAtIndex+](seq=flatten_5, indices=allIndicesOf_5, replacement=code_block_44)
list_create_2 = List.Create()  # unwired: item0, item1, item2
boundingBox_2 = Element.BoundingBox(element=filterByBoolMask_2.in)
properties_2 = Custom[BoundingBox.Properties](boundingBox=boundingBox_2@L1)
combine_2 = List.Combine(combineFunction=list_create_2, list0=properties_2.Width, list1=properties_2.Depth, list2=properties_2.Height)
ꟿ_list_maxindex_2 = Custom[ꟿ List.MaxIndex](list=combine_2)
count = List.Count(list=boundingBox_2@L2)
chop = List.Chop(list=ꟿ_list_maxindex_2.idx, lengths=count)
groupByKey_3 = List.GroupByKey(list=replaceItemAtIndex_2@L2, keys=chop@L2)
code_block_45 = CodeBlock { 100; }
ꟿ_geometry_groupbydistance_2 = Custom[ꟿ Geometry.GroupByDistance](geometry=groupByKey_3.groups@L2, margin=code_block_45)
byUnion_2 = Solid.ByUnion(solids=ꟿ_geometry_groupbydistance_2@L2)
code_block_46 = CodeBlock(a=byUnion_2) { List.Flatten(UnalignedCuboid(a),-1); }
code_block_47 = CodeBlock(gmt=code_block_46) { List.Flatten(CenterLine(gmt),-1); }
code_block_48 = CodeBlock(line1=code_block_47, cub=code_block_46)
# ---------- code_block_48.designscript (7 lines) ----------
t2 = List.Flatten(line1, -1);
num1 = Autodesk.Curve.Length(t2);
t1 = ((num1 < 300 ? true : false));
t3 = List.FilterByBoolMask(t2, t1);
t5 = Dictionary.ValueAtKey(t3, "out");
t6 = List.FilterByBoolMask(cub, t1);
t7 = Dictionary.ValueAtKey(t6, "out");
# ----------------------------------------
code_block_49 = CodeBlock(t1=code_block_48.t5)
# ---------- code_block_49.designscript (7 lines) ----------
curve1 = Autodesk.Curve.ExtendStart(t1, 110);
curve2 = Autodesk.Curve.ExtendEnd(curve1, 110);
geometry1 = Autodesk.Geometry.Intersect(curve2<1>, curve2<2>);
t3 = List.Clean(List.Flatten(geometry1, -1), true);
bool1 = String.Contains(DSCore.Object.Type(t3), "Point", false);
t4 = List.FilterByBoolMask(t3, bool1);
t5 = Dictionary.ValueAtKey(t4, "in");
# ----------------------------------------
code_block_50 = CodeBlock { 100; }
code_block_51 = CodeBlock(lin=code_block_48.t5, pnt=code_block_49.t5, mar=code_block_50) { TransferredLine(lin, pnt, mar); }
code_block_52 = CodeBlock { 300; }
boolean_4 = BoolSelector(true)
boolean_5 = BoolSelector(false)
code_block_53 = CodeBlock { 600; }
code_block_54 = CodeBlock { 300; }
code_block_55 = CodeBlock { 600; }
groupByKey_4 = List.GroupByKey(list=filterByBoolMask_2.in@L2, keys=chop@L2)
count_2 = List.Count(list=getParameterValueByName_2@L2)
chop_2 = List.Chop(list=anyTrue, lengths=count_2)

code_block_56 = CodeBlock(p=code_block_37, f=code_block_51) { [p,f]; }
code_block_57 = CodeBlock(a=code_block_56) { List.Flatten([Line.StartPoint(a),Line.EndPoint(a)],-1); }
tolerance_for_aligning_points = DoubleInput(300)  # graph input
code_block_58 = CodeBlock(p=code_block_57, m=tolerance_for_aligning_points) { List.Flatten(AglinCoordX(p,m),-1); }
code_block_59 = CodeBlock(p=code_block_58, m=tolerance_for_aligning_points) { List.Flatten(AglinCoordY(p,m),-1); }

# group (continued): FLOORS
code_block_60 = CodeBlock(lin=code_block_37, pnt=code_block_59, mar=code_block_38) { TransferredLine(lin,pnt, mar); }

# group (continued): PLATE
code_block_61 = CodeBlock(lin=code_block_51, pnt=code_block_59, mar=code_block_52) { TransferredLine(lin,pnt,mar); }
distanceTo_3 = Geometry.DistanceTo(geometry=code_block_61, other=code_block_60, lacing=CrossProduct)
code_block_62 = CodeBlock(a=distanceTo_3) { List.MinimumItem(a)<300?true:false; }
allIndicesOf_6 = List.AllIndicesOf(list=code_block_62, item=boolean_4)
getItemAtIndex_5 = List.GetItemAtIndex(list=code_block_61, index=allIndicesOf_6)
code_block_63 = CodeBlock(a=getItemAtIndex_5) { a; }
startPoint = Curve.StartPoint(curve=code_block_63)
distanceTo_4 = Geometry.DistanceTo(geometry=code_block_63, other=code_block_60, lacing=CrossProduct)
ꟿ_list_minindex = Custom[ꟿ List.MinIndex](list=distanceTo_4)  # package spring nodes; Gets the minimum index of a list. Good for use with floating point values
getItemAtIndex_6 = List.GetItemAtIndex(list=code_block_60, index=ꟿ_list_minindex.idx)
code_block_64 = CodeBlock(a=getItemAtIndex_6) { Point.Z(Line.StartPoint(a)); }
bk_replace_point_z_value = Custom[BK.Replace Point Z Value](VARpoints=startPoint, VARdesiredZvalue=code_block_64)  # package Synthesize toolkit
endPoint = Curve.EndPoint(curve=code_block_63)
bk_replace_point_z_value_2 = Custom[BK.Replace Point Z Value](VARpoints=endPoint, VARdesiredZvalue=code_block_64)
byStartPointEndPoint_3 = Line.ByStartPointEndPoint(startPoint=bk_replace_point_z_value, endPoint=bk_replace_point_z_value_2)
replaceItemAtIndex_3 = Custom[List.ReplaceItemAtIndex+](seq=code_block_61, indices=allIndicesOf_6, replacement=byStartPointEndPoint_3)

allIndicesOf_7 = List.AllIndicesOf(list=code_block_62, item=boolean_5)

# group (continued): PLATE
getItemAtIndex_7 = List.GetItemAtIndex(list=code_block_61, index=allIndicesOf_7)
startPoint_2 = Curve.StartPoint(curve=getItemAtIndex_7)
code_block_65 = CodeBlock(p=startPoint_2, m=code_block_53) { AglinCoordZ(p,m); }
endPoint_2 = Curve.EndPoint(curve=getItemAtIndex_7)
code_block_66 = CodeBlock(p=endPoint_2, m=code_block_53) { AglinCoordZ(p,m); }
byStartPointEndPoint_4 = Line.ByStartPointEndPoint(startPoint=code_block_65, endPoint=code_block_66)
replaceItemAtIndex_4 = Custom[List.ReplaceItemAtIndex+](seq=replaceItemAtIndex_3, indices=allIndicesOf_7, replacement=byStartPointEndPoint_4)

# group: STUD, CRIPPLE
code_block_67 = CodeBlock(p=replaceItemAtIndex_4, f=code_block_60) { List.Flatten([p,f]); }
code_block_68 = CodeBlock(e=all_elements_of_category_in_view) { e; }
code_block_69 = CodeBlock { "Name(Data)"; }
getParameterValueByName_3 = Element.GetParameterValueByName(element=code_block_68, parameterName=code_block_69)
code_block_70 = CodeBlock { ["STUD","CRIPPLE"]; }
eq_3 = getParameterValueByName_3@L2 == code_block_70  # lacing=CrossProduct
transpose_2 = List.Transpose(lists=eq_3@L3)
anyTrue_2 = List.AnyTrue(list=transpose_2@L2)
filterByBoolMask_3 = List.FilterByBoolMask(list=code_block_68, mask=anyTrue_2)
geometry_3 = Element.Geometry(element=filterByBoolMask_3.in)
flatten_6 = List.Flatten(list=geometry_3@L3)
code_block_71 = CodeBlock(a=flatten_6) { String.Contains(DSCore.Object.Type(a), "Mesh", false); }
boolean_6 = BoolSelector(true)
allIndicesOf_8 = List.AllIndicesOf(list=code_block_71, item=boolean_6)
getItemAtIndex_8 = List.GetItemAtIndex(list=flatten_6, index=allIndicesOf_8)
code_block_72 = CodeBlock(msh=getItemAtIndex_8) { List.Flatten(MeshToCubid(msh),-1); }
replaceItemAtIndex_5 = Custom[List.ReplaceItemAtIndex+](seq=flatten_6, indices=allIndicesOf_8, replacement=code_block_72)
list_create_3 = List.Create()  # unwired: item0, item1, item2
boundingBox_3 = Element.BoundingBox(element=filterByBoolMask_3.in)
properties_3 = Custom[BoundingBox.Properties](boundingBox=boundingBox_3@L1)
combine_3 = List.Combine(combineFunction=list_create_3, list0=properties_3.Width, list1=properties_3.Depth, list2=properties_3.Height)
ꟿ_list_maxindex_3 = Custom[ꟿ List.MaxIndex](list=combine_3)
count_3 = List.Count(list=boundingBox_3@L2)
chop_3 = List.Chop(list=ꟿ_list_maxindex_3.idx, lengths=count_3)
groupByKey_5 = List.GroupByKey(list=replaceItemAtIndex_5@L2, keys=chop_3@L2)
code_block_73 = CodeBlock { 100; }
ꟿ_geometry_groupbydistance_3 = Custom[ꟿ Geometry.GroupByDistance](geometry=groupByKey_5.groups@L2, margin=code_block_73)
byUnion_3 = Solid.ByUnion(solids=ꟿ_geometry_groupbydistance_3@L2)
code_block_74 = CodeBlock(a=byUnion_3) { List.Flatten(UnalignedCuboid(a),-1); }
code_block_75 = CodeBlock(gmt=code_block_74) { List.Flatten(CenterLine(gmt),-1); }
code_block_76 = CodeBlock(line1=code_block_75, cub=code_block_74)
# ---------- code_block_76.designscript (7 lines) ----------
t2 = List.Flatten(line1, -1);
num1 = Autodesk.Curve.Length(t2);
t1 = ((num1 < 250 ? true : false));
t3 = List.FilterByBoolMask(t2, t1);
t5 = Dictionary.ValueAtKey(t3, "out");
t6 = List.FilterByBoolMask(cub, t1);
t7 = Dictionary.ValueAtKey(t6, "out");
# ----------------------------------------
code_block_77 = CodeBlock(p=code_block_67, f=code_block_76.t5) { [p,f]; }
code_block_78 = CodeBlock(a=code_block_77) { List.Flatten([Line.StartPoint(a),Line.EndPoint(a)],-1); }
code_block_79 = CodeBlock(p=code_block_78, m=tolerance_for_aligning_points) { List.Flatten(AglinCoordX(p,m),-1); }
code_block_80 = CodeBlock(p=code_block_79, m=tolerance_for_aligning_points) { List.Flatten(AglinCoordY(p,m),-1); }
code_block_81 = CodeBlock(p=code_block_80) { List.Flatten(AglinCoordZ(p,200),-1); }
code_block_82 = CodeBlock { 300; }
code_block_83 = CodeBlock(lin=code_block_76.t5, pnt=code_block_81, mar=code_block_82) { TransferredLine(lin, pnt, mar); }
code_block_84 = CodeBlock { 300; }
code_block_85 = CodeBlock { 100; }
boolean_7 = BoolSelector(false)

# group (continued): FLOORS
passThrough = Custom[PassThrough](passThrough=code_block_81, waitFor=code_block_81)  # package archi-lab.net; Ripped this off from Clockwork. Sorry Andy.
code_block_86 = CodeBlock(lin=code_block_60, pnt=passThrough, mar=code_block_39) { TransferredLine(lin, pnt, mar); }

# group (continued): PLATE
passThrough_2 = Custom[PassThrough](passThrough=code_block_81, waitFor=code_block_81)
code_block_87 = CodeBlock(lin=replaceItemAtIndex_4, pnt=passThrough_2, mar=code_block_54) { TransferredLine(lin, pnt, mar); }
startPoint_3 = Curve.StartPoint(curve=code_block_87)
endPoint_3 = Curve.EndPoint(curve=code_block_87)

code_block_88 = CodeBlock(p=code_block_86, f=code_block_87) { List.Flatten([p,f]); }

# group (continued): STUD, CRIPPLE
closestPointTo_3 = Geometry.ClosestPointTo(geometry=code_block_88, other=code_block_83, lacing=CrossProduct)
flatten_7 = List.Flatten(list=closestPointTo_3)
code_block_89 = CodeBlock(lin=code_block_83, pnt=flatten_7, mar=code_block_84) { TransferredLine(lin, pnt, mar); }
code_block_90 = CodeBlock(a=code_block_88) { List.Flatten([Line.StartPoint(a),Line.EndPoint(a)],-1); }
code_block_91 = CodeBlock(lin=code_block_89, pnt=code_block_90, mar=code_block_85) { TransferredLine(lin, pnt, mar); }
direction_2 = Line.Direction(line=code_block_91)
code_block_92 = CodeBlock(vector1=direction_2)
# ---------- code_block_92.designscript (4 lines) ----------
t1 = Autodesk.Vector.X(vector1) == 0;
t2 = Autodesk.Vector.Y(vector1) == 0;
t3 = t1@L2<1> && t2@L2<1>;
List.Flatten(t3,-1);
# ----------------------------------------
allIndicesOf_9 = List.AllIndicesOf(list=code_block_92.out3, item=boolean_7)
isEmpty = List.IsEmpty(list=allIndicesOf_9)
getItemAtIndex_9 = List.GetItemAtIndex(list=code_block_91, index=allIndicesOf_9)
code_block_93 = CodeBlock(a=getItemAtIndex_9, p=code_block_90)
# ---------- code_block_93.designscript (10 lines) ----------
t1 = Autodesk.Curve.EndPoint(a);
t2 = Autodesk.Curve.StartPoint(a);
bool1 = List.Equals(t2@L1<1>, p@L1<2>);
b1 = List.AnyTrue(bool1@L2<1>);
bool2 = List.Equals(t1@L1<1>, p@L1<2>);
b2 = List.AnyTrue(bool2@L2<1>);
p1 = Point.ByCoordinates(Point.X(t1), Point.Y(t1), Point.Z(t2));
p2 = Point.ByCoordinates(Point.X(t2), Point.Y(t2), Point.Z(t1));
b3 = b1==b2;
num1 = List.AllIndicesOf(b3, true);
# ----------------------------------------
getItemAtIndex_10 = List.GetItemAtIndex(list=code_block_93.p1, index=code_block_93.num1)
doesIntersect = Geometry.DoesIntersect(geometry=getItemAtIndex_10, other=code_block_90, lacing=CrossProduct)
countTrue = List.CountTrue(list=doesIntersect@L2)
getItemAtIndex_11 = List.GetItemAtIndex(list=code_block_93.p2, index=code_block_93.num1)
doesIntersect_2 = Geometry.DoesIntersect(geometry=getItemAtIndex_11, other=code_block_90, lacing=CrossProduct)
countTrue_2 = List.CountTrue(list=doesIntersect_2@L2)
code_block_94 = CodeBlock(n1=countTrue, n2=countTrue_2) { n1>n2?true:false; }
replaceItemAtIndex_6 = Custom[List.ReplaceItemAtIndex+](seq=code_block_93.b1, indices=code_block_93.num1, replacement=code_block_94)
code_block_95 = CodeBlock(b1=replaceItemAtIndex_6, t2=code_block_93.t2, p1=code_block_93.p1, b2=code_block_93.b2, t1=code_block_93.t1, p2=code_block_93.p2) { ps = ((b1==true?t2:p1)); pe = ((b2==true?t1:p2)); }
byStartPointEndPoint_5 = Line.ByStartPointEndPoint(startPoint=code_block_95.ps, endPoint=code_block_95.pe)
replaceItemAtIndex_7 = Custom[List.ReplaceItemAtIndex+](seq=code_block_91, indices=allIndicesOf_9, replacement=byStartPointEndPoint_5)
if_ = RefactoredIf(test=isEmpty, true=code_block_91, false=replaceItemAtIndex_7)

# group: ROOFS
code_block_96 = CodeBlock(e=all_elements_of_category_in_view) { e; }
code_block_97 = CodeBlock { "Sublabel2(Data)"; "ROOFS"; }
getParameterValueByName_4 = Element.GetParameterValueByName(element=code_block_96, parameterName=code_block_97.out0)
eq_4 = getParameterValueByName_4 == code_block_97.out1
filterByBoolMask_4 = List.FilterByBoolMask(list=code_block_96, mask=eq_4)
code_block_98 = CodeBlock { "Name(Data)"; "RIMBOARD"; }
getParameterValueByName_5 = Element.GetParameterValueByName(element=filterByBoolMask_4.in, parameterName=code_block_98.out0)
eq_5 = getParameterValueByName_5 == code_block_98.out1
filterByBoolMask_5 = List.FilterByBoolMask(list=filterByBoolMask_4.in, mask=eq_5)
flatten_8 = List.Flatten(list=filterByBoolMask_5.in)
geometry_4 = Element.Geometry(element=flatten_8)
flatten_9 = List.Flatten(list=geometry_4)
code_block_99 = CodeBlock(a=flatten_9) { String.Contains(DSCore.Object.Type(a), "Mesh", false); }
boolean_8 = BoolSelector(true)
allIndicesOf_10 = List.AllIndicesOf(list=code_block_99, item=boolean_8)
getItemAtIndex_12 = List.GetItemAtIndex(list=flatten_9, index=allIndicesOf_10)
code_block_100 = CodeBlock(msh=getItemAtIndex_12) { List.Flatten(MeshToCubid(msh),-1); }
replaceItemAtIndex_8 = Custom[List.ReplaceItemAtIndex+](seq=flatten_9, indices=allIndicesOf_10, replacement=code_block_100)
code_block_101 = CodeBlock { 100; }
ꟿ_geometry_groupbydistance_4 = Custom[ꟿ Geometry.GroupByDistance](geometry=replaceItemAtIndex_8, margin=code_block_101)
byUnion_4 = Solid.ByUnion(solids=ꟿ_geometry_groupbydistance_4@L2)
code_block_102 = CodeBlock(a=byUnion_4) { List.Flatten(UnalignedCuboid(a),-1); }
code_block_103 = CodeBlock(gmt=code_block_102) { List.Flatten(CenterLine(gmt),-1); }
code_block_104 = CodeBlock(line1=code_block_103, cub=code_block_102)  # same code as code_block_29
code_block_105 = CodeBlock(s=if_) { s; }
closestPointTo_4 = Geometry.ClosestPointTo(geometry=code_block_105, other=code_block_104.t5, lacing=CrossProduct)
flatten_10 = List.Flatten(list=closestPointTo_4)
code_block_106 = CodeBlock { 300; }
code_block_107 = CodeBlock(lin=code_block_104.t5, pnt=flatten_10, mar=code_block_106) { TransferredLine(lin, pnt, mar); }
code_block_108 = CodeBlock { "Name(Data)"; "RAFTER"; }
getParameterValueByName_6 = Element.GetParameterValueByName(element=filterByBoolMask_4.in, parameterName=code_block_108.out0)
eq_6 = getParameterValueByName_6 == code_block_108.out1
filterByBoolMask_6 = List.FilterByBoolMask(list=filterByBoolMask_4.in, mask=eq_6)
flatten_11 = List.Flatten(list=filterByBoolMask_6.in)
geometry_5 = Element.Geometry(element=flatten_11)
flatten_12 = List.Flatten(list=geometry_5)
code_block_109 = CodeBlock(a=flatten_12) { String.Contains(DSCore.Object.Type(a), "Mesh", false); }
boolean_9 = BoolSelector(true)
allIndicesOf_11 = List.AllIndicesOf(list=code_block_109, item=boolean_9)
getItemAtIndex_13 = List.GetItemAtIndex(list=flatten_12, index=allIndicesOf_11)
code_block_110 = CodeBlock(msh=getItemAtIndex_13) { List.Flatten(MeshToCubid(msh),-1); }
replaceItemAtIndex_9 = Custom[List.ReplaceItemAtIndex+](seq=flatten_12, indices=allIndicesOf_11, replacement=code_block_110)
code_block_111 = CodeBlock { 100; }
ꟿ_geometry_groupbydistance_5 = Custom[ꟿ Geometry.GroupByDistance](geometry=replaceItemAtIndex_9, margin=code_block_111)
byUnion_5 = Solid.ByUnion(solids=ꟿ_geometry_groupbydistance_5@L2)
code_block_112 = CodeBlock(a=byUnion_5) { List.Flatten(UnalignedCuboid(a),-1); }
code_block_113 = CodeBlock(gmt=code_block_112) { List.Flatten(CenterLine(gmt),-1); }
code_block_114 = CodeBlock(line1=code_block_113, cub=code_block_112)  # same code as code_block_29
closestPointTo_5 = Geometry.ClosestPointTo(geometry=code_block_107, other=code_block_114.t5, lacing=CrossProduct)
flatten_13 = List.Flatten(list=closestPointTo_5)
code_block_115 = CodeBlock { 300; }
code_block_116 = CodeBlock(lin=code_block_114.t5, pnt=flatten_13, mar=code_block_115) { TransferredLine(lin, pnt, mar); }
code_block_117 = CodeBlock { "Name(Data)"; "BLOCKING"; }
getParameterValueByName_7 = Element.GetParameterValueByName(element=filterByBoolMask_4.in, parameterName=code_block_117.out0)
eq_7 = getParameterValueByName_7 == code_block_117.out1
filterByBoolMask_7 = List.FilterByBoolMask(list=filterByBoolMask_4.in, mask=eq_7)
flatten_14 = List.Flatten(list=filterByBoolMask_7.in)
geometry_6 = Element.Geometry(element=flatten_14)
flatten_15 = List.Flatten(list=geometry_6)
code_block_118 = CodeBlock(a=flatten_15) { String.Contains(DSCore.Object.Type(a), "Mesh", false); }
boolean_10 = BoolSelector(true)
allIndicesOf_12 = List.AllIndicesOf(list=code_block_118, item=boolean_10)
getItemAtIndex_14 = List.GetItemAtIndex(list=flatten_15, index=allIndicesOf_12)
code_block_119 = CodeBlock(msh=getItemAtIndex_14) { List.Flatten(MeshToCubid(msh),-1); }
replaceItemAtIndex_10 = Custom[List.ReplaceItemAtIndex+](seq=flatten_15, indices=allIndicesOf_12, replacement=code_block_119)
code_block_120 = CodeBlock { 100; }
ꟿ_geometry_groupbydistance_6 = Custom[ꟿ Geometry.GroupByDistance](geometry=replaceItemAtIndex_10, margin=code_block_120)
byUnion_6 = Solid.ByUnion(solids=ꟿ_geometry_groupbydistance_6@L2)
code_block_121 = CodeBlock(a=byUnion_6) { List.Flatten(UnalignedCuboid(a),-1); }
code_block_122 = CodeBlock(gmt=code_block_121) { List.Flatten(CenterLine(gmt),-1); }
code_block_123 = CodeBlock(line1=code_block_122, cub=code_block_121)  # same code as code_block_29
closestPointTo_6 = Geometry.ClosestPointTo(geometry=code_block_116, other=code_block_123.t5, lacing=CrossProduct)
flatten_16 = List.Flatten(list=closestPointTo_6)
code_block_124 = CodeBlock { 300; }
code_block_125 = CodeBlock(lin=code_block_123.t5, pnt=flatten_16, mar=code_block_124) { TransferredLine(lin, pnt, mar); }

code_block_126 = CodeBlock(f=code_block_86, r=code_block_107, rf=code_block_116) { List.Flatten([f,r,rf],-1); }
byCurve = StructuralDesign.Model.AnalyticalModel.AnalyticalMember.ByCurve(curve=code_block_126)
code_block_127 = CodeBlock { "LVL"; }
byName = Family.ByName(name=code_block_127)
types = Family.Types(family=byName)
code_block_128 = CodeBlock(a=types) { a.Name; }
sortByKey_4 = List.SortByKey(list=types, keys=code_block_128)
code_block_129 = CodeBlock { "b"; }
getParameterValueByName_8 = Element.GetParameterValueByName(element=sortByKey_4.sortedList, parameterName=code_block_129)
uniqueItems = List.UniqueItems(list=getParameterValueByName_8)
sort = List.Sort(list=uniqueItems)
code_block_130 = CodeBlock(f=code_block_29.t7, r=code_block_104.t7, rf=code_block_114.t7) { List.Flatten([f,r,rf],-1); }
width = Cuboid.Width(cuboid=code_block_130)
round = Math.Round(number=width)
code_block_131 = CodeBlock(dd=sort, tt=round) { NearNumber(dd,tt); }
ꟿ_number_tostring = Custom[ꟿ Number.ToString](num=code_block_131)  # package spring nodes; Converts the input number(s) to string. You can optionally limit the number of digits.
code_block_132 = CodeBlock { "d"; }
getParameterValueByName_9 = Element.GetParameterValueByName(element=sortByKey_4.sortedList, parameterName=code_block_132)
uniqueItems_2 = List.UniqueItems(list=getParameterValueByName_9)
sort_2 = List.Sort(list=uniqueItems_2)
height = Cuboid.Height(cuboid=code_block_130)
round_2 = Math.Round(number=height)
code_block_133 = CodeBlock(dd=sort_2, tt=round_2) { NearNumber(dd,tt); }
ꟿ_number_tostring_2 = Custom[ꟿ Number.ToString](num=code_block_133)
code_block_134 = CodeBlock(b=ꟿ_number_tostring, d=ꟿ_number_tostring_2) { b+"x"+d; }
byName_2 = FamilyType.ByName(name=code_block_134)
setSectionType = StructuralDesign.Model.AnalyticalModel.AnalyticalMember.SetSectionType(analiticalMember=byCurve, type=byName_2)
structural_roles = StructuralRoleComboBox("Beam")
setStructuralRole = StructuralDesign.Model.AnalyticalModel.AnalyticalMember.SetStructuralRole(analiticalMember=byCurve, structuralRole=structural_roles)
code_block_135 = CodeBlock { "hsbCAD_LVL"; }
byName_3 = Material.ByName(name=code_block_135)
setMaterial = StructuralDesign.Model.AnalyticalModel.AnalyticalMember.SetMaterial(analiticalMember=byCurve, material=byName_3)

# group (continued): PLATE
doesIntersect_3 = Geometry.DoesIntersect(geometry=startPoint_3, other=if_, lacing=CrossProduct)
anyTrue_3 = List.AnyTrue(list=doesIntersect_3@L2)
doesIntersect_4 = Geometry.DoesIntersect(geometry=endPoint_3, other=if_, lacing=CrossProduct)
anyTrue_4 = List.AnyTrue(list=doesIntersect_4@L2)
and_ = anyTrue_3 && anyTrue_4
filterByBoolMask_8 = List.FilterByBoolMask(list=code_block_87, mask=and_)
code_block_136 = CodeBlock(a=filterByBoolMask_8.out) { a; }
closestPointTo_7 = Geometry.ClosestPointTo(geometry=if_, other=code_block_136, lacing=CrossProduct)
flatten_17 = List.Flatten(list=closestPointTo_7)
code_block_137 = CodeBlock(lin=code_block_136, pnt=flatten_17, mar=code_block_55) { TransferredLine(lin, pnt, mar); }
code_block_138 = CodeBlock(a=filterByBoolMask_8.in, b=code_block_137) { List.Flatten([a,b]); }

# group: SILL,LINTEL,TRANSOM
code_block_139 = CodeBlock(e=all_elements_of_category_in_view) { e; }
code_block_140 = CodeBlock { "Name(Data)"; }
getParameterValueByName_10 = Element.GetParameterValueByName(element=code_block_139, parameterName=code_block_140)
code_block_141 = CodeBlock { ["SILL","LINTEL","TRANSOM"]; }
eq_8 = getParameterValueByName_10@L2 == code_block_141  # lacing=CrossProduct
transpose_3 = List.Transpose(lists=eq_8@L3)
anyTrue_5 = List.AnyTrue(list=transpose_3@L2)
filterByBoolMask_9 = List.FilterByBoolMask(list=code_block_139, mask=anyTrue_5)
geometry_7 = Element.Geometry(element=filterByBoolMask_9.in)
flatten_18 = List.Flatten(list=geometry_7@L3)
code_block_142 = CodeBlock(a=flatten_18) { String.Contains(DSCore.Object.Type(a), "Mesh", false); }
boolean_11 = BoolSelector(true)
allIndicesOf_13 = List.AllIndicesOf(list=code_block_142, item=boolean_11)
getItemAtIndex_15 = List.GetItemAtIndex(list=flatten_18, index=allIndicesOf_13)
code_block_143 = CodeBlock(msh=getItemAtIndex_15) { List.Flatten(MeshToCubid(msh),-1); }
replaceItemAtIndex_11 = Custom[List.ReplaceItemAtIndex+](seq=flatten_18, indices=allIndicesOf_13, replacement=code_block_143)
list_create_4 = List.Create()  # unwired: item0, item1, item2
boundingBox_4 = Element.BoundingBox(element=filterByBoolMask_9.in)
properties_4 = Custom[BoundingBox.Properties](boundingBox=boundingBox_4@L1)
combine_4 = List.Combine(combineFunction=list_create_4, list0=properties_4.Width, list1=properties_4.Depth, list2=properties_4.Height)
ꟿ_list_maxindex_4 = Custom[ꟿ List.MaxIndex](list=combine_4)
count_4 = List.Count(list=boundingBox_4@L2)
chop_4 = List.Chop(list=ꟿ_list_maxindex_4.idx, lengths=count_4)
groupByKey_6 = List.GroupByKey(list=replaceItemAtIndex_11@L2, keys=chop_4@L2)
code_block_144 = CodeBlock { 100; }
ꟿ_geometry_groupbydistance_7 = Custom[ꟿ Geometry.GroupByDistance](geometry=groupByKey_6.groups@L2, margin=code_block_144)
byUnion_7 = Solid.ByUnion(solids=ꟿ_geometry_groupbydistance_7@L2)
code_block_145 = CodeBlock(a=byUnion_7) { List.Flatten(UnalignedCuboid(a),-1); }
code_block_146 = CodeBlock(gmt=code_block_145) { List.Flatten(CenterLine(gmt),-1); }
code_block_147 = CodeBlock(line1=code_block_146, cub=code_block_145)  # same code as code_block_29
code_block_148 = CodeBlock(a=if_) { a; }
closestPointTo_8 = Geometry.ClosestPointTo(geometry=code_block_148, other=code_block_147.t5, lacing=CrossProduct)
flatten_19 = List.Flatten(list=closestPointTo_8)
code_block_149 = CodeBlock { 500; }
code_block_150 = CodeBlock(lin=code_block_147.t5, pnt=flatten_19, mar=code_block_149) { TransferredLine(lin, pnt, mar); }

# group: SILL STUDS, LINTEL PACKERS
code_block_151 = CodeBlock(e=all_elements_of_category_in_view) { e; }
code_block_152 = CodeBlock { "Name(Data)"; }
getParameterValueByName_11 = Element.GetParameterValueByName(element=code_block_151, parameterName=code_block_152)
code_block_153 = CodeBlock { ["SILL STUDS","LINTEL PACKERS"]; }
eq_9 = getParameterValueByName_11@L2 == code_block_153  # lacing=CrossProduct
transpose_4 = List.Transpose(lists=eq_9@L3)
anyTrue_6 = List.AnyTrue(list=transpose_4@L2)
filterByBoolMask_10 = List.FilterByBoolMask(list=code_block_151, mask=anyTrue_6)
geometry_8 = Element.Geometry(element=filterByBoolMask_10.in)
flatten_20 = List.Flatten(list=geometry_8@L3)
code_block_154 = CodeBlock(a=flatten_20) { String.Contains(DSCore.Object.Type(a), "Mesh", false); }
boolean_12 = BoolSelector(true)
allIndicesOf_14 = List.AllIndicesOf(list=code_block_154, item=boolean_12)
getItemAtIndex_16 = List.GetItemAtIndex(list=flatten_20, index=allIndicesOf_14)
code_block_155 = CodeBlock(msh=getItemAtIndex_16) { List.Flatten(MeshToCubid(msh),-1); }
replaceItemAtIndex_12 = Custom[List.ReplaceItemAtIndex+](seq=flatten_20, indices=allIndicesOf_14, replacement=code_block_155)
list_create_5 = List.Create()  # unwired: item0, item1, item2
boundingBox_5 = Element.BoundingBox(element=filterByBoolMask_10.in)
properties_5 = Custom[BoundingBox.Properties](boundingBox=boundingBox_5@L1)
combine_5 = List.Combine(combineFunction=list_create_5, list0=properties_5.Width, list1=properties_5.Depth, list2=properties_5.Height)
ꟿ_list_maxindex_5 = Custom[ꟿ List.MaxIndex](list=combine_5)
count_5 = List.Count(list=boundingBox_5@L2)
chop_5 = List.Chop(list=ꟿ_list_maxindex_5.idx, lengths=count_5)
groupByKey_7 = List.GroupByKey(list=replaceItemAtIndex_12@L2, keys=chop_5@L2)
code_block_156 = CodeBlock { 100; }
ꟿ_geometry_groupbydistance_8 = Custom[ꟿ Geometry.GroupByDistance](geometry=groupByKey_7.groups@L2, margin=code_block_156)
byUnion_8 = Solid.ByUnion(solids=ꟿ_geometry_groupbydistance_8@L2)
code_block_157 = CodeBlock(a=byUnion_8) { List.Flatten(UnalignedCuboid(a),-1); }
code_block_158 = CodeBlock(gmt=code_block_157) { List.Flatten(CenterLine(gmt),-1); }
code_block_159 = CodeBlock(line1=code_block_158, cub=code_block_157)  # same code as code_block_29
code_block_160 = CodeBlock(a=code_block_159.t5, s=if_) { num1 = Autodesk.Geometry.DistanceTo(a<1>, s); t5 = List.MinimumItem(num1); t2 = ((t5 < 100 ? true : false)); }
filterByBoolMask_11 = List.FilterByBoolMask(list=code_block_159.t5, mask=code_block_160.t2)
code_block_161 = CodeBlock(p=code_block_138, f=code_block_86, l=code_block_150) { List.Flatten([p,f,l]); }
closestPointTo_9 = Geometry.ClosestPointTo(geometry=code_block_161, other=filterByBoolMask_11.out, lacing=CrossProduct)
flatten_21 = List.Flatten(list=closestPointTo_9)
code_block_162 = CodeBlock { 300; }
code_block_163 = CodeBlock(lin=filterByBoolMask_11.out, pnt=flatten_21, mar=code_block_162) { TransferredLine(lin, pnt, mar); }
filterByBoolMask_12 = List.FilterByBoolMask(list=code_block_159.t7, mask=code_block_160.t2)

direction_3 = Line.Direction(line=code_block_163)
code_block_164 = CodeBlock(vector1=direction_3) { t1 = Autodesk.Vector.X(vector1) == 0; t2 = Autodesk.Vector.Y(vector1) == 0; t3 = t1@L2<1> && t2@L2<1>; }
flatten_22 = List.Flatten(list=code_block_164.t3)
boolean_13 = BoolSelector(false)
allIndicesOf_15 = List.AllIndicesOf(list=flatten_22, item=boolean_13)
getItemAtIndex_17 = List.GetItemAtIndex(list=code_block_163, index=allIndicesOf_15)
code_block_165 = CodeBlock(a=getItemAtIndex_17, p=code_block_150)
# ---------- code_block_165.designscript (10 lines) ----------
t1 = Autodesk.Curve.EndPoint(a);
t2 = Autodesk.Curve.StartPoint(a);
bool1 = Autodesk.Geometry.DoesIntersect(t2@L1<1>, p@L1<2>);
b1 = List.AnyTrue(bool1@L2<1>);
bool2 = Autodesk.Geometry.DoesIntersect(t1@L1<1>, p@L1<2>);
b2 = List.AnyTrue(bool2@L2<1>);
p1 = Point.ByCoordinates(Point.X(t1), Point.Y(t1), Point.Z(t2));
p2 = Point.ByCoordinates(Point.X(t2), Point.Y(t2), Point.Z(t1));
ps = ((b1==true?t2:p1));
pe = ((b2==true?t1:p2));
# ----------------------------------------
byStartPointEndPoint_6 = Line.ByStartPointEndPoint(startPoint=code_block_165.ps, endPoint=code_block_165.pe)
replaceItemAtIndex_13 = Custom[List.ReplaceItemAtIndex+](seq=code_block_163, indices=allIndicesOf_15, replacement=byStartPointEndPoint_6)
code_block_166 = CodeBlock(s=if_, p=replaceItemAtIndex_13) { List.Flatten([s,p],-1); }
byCurve_2 = StructuralDesign.Model.AnalyticalModel.AnalyticalMember.ByCurve(curve=code_block_166)
code_block_167 = CodeBlock { "PINE"; }
byName_4 = Family.ByName(name=code_block_167)
types_2 = Family.Types(family=byName_4)
code_block_168 = CodeBlock(a=types_2) { a.Name; }
sortByKey_5 = List.SortByKey(list=types_2, keys=code_block_168)
code_block_169 = CodeBlock { "b"; }
getParameterValueByName_12 = Element.GetParameterValueByName(element=sortByKey_5.sortedList, parameterName=code_block_169)
uniqueItems_3 = List.UniqueItems(list=getParameterValueByName_12)
sort_3 = List.Sort(list=uniqueItems_3)
code_block_170 = CodeBlock(s=code_block_76.t7, p=filterByBoolMask_12.out) { List.Flatten([s,p],-1); }
width_2 = Cuboid.Width(cuboid=code_block_170)
round_3 = Math.Round(number=width_2)
code_block_171 = CodeBlock(dd=sort_3, tt=round_3) { NearNumber(dd,tt); }
ꟿ_number_tostring_3 = Custom[ꟿ Number.ToString](num=code_block_171)
code_block_172 = CodeBlock { "d"; }
getParameterValueByName_13 = Element.GetParameterValueByName(element=sortByKey_5.sortedList, parameterName=code_block_172)
uniqueItems_4 = List.UniqueItems(list=getParameterValueByName_13)
sort_4 = List.Sort(list=uniqueItems_4)
height_2 = Cuboid.Height(cuboid=code_block_170)
round_4 = Math.Round(number=height_2)
code_block_173 = CodeBlock(dd=sort_4, tt=round_4) { NearNumber(dd,tt); }
ꟿ_number_tostring_4 = Custom[ꟿ Number.ToString](num=code_block_173)
code_block_174 = CodeBlock(b=ꟿ_number_tostring_3, d=ꟿ_number_tostring_4) { "C_"+b+"x"+d; }
byName_5 = FamilyType.ByName(name=code_block_174)
setSectionType_2 = StructuralDesign.Model.AnalyticalModel.AnalyticalMember.SetSectionType(analiticalMember=byCurve_2, type=byName_5)
structural_roles_2 = StructuralRoleComboBox("Column")
setStructuralRole_2 = StructuralDesign.Model.AnalyticalModel.AnalyticalMember.SetStructuralRole(analiticalMember=byCurve_2, structuralRole=structural_roles_2)
code_block_175 = CodeBlock { "hsbCAD_PINE"; }
byName_6 = Material.ByName(name=code_block_175)
setMaterial_2 = StructuralDesign.Model.AnalyticalModel.AnalyticalMember.SetMaterial(analiticalMember=byCurve_2, material=byName_6)

# group: BLOCKING
code_block_176 = CodeBlock(e=all_elements_of_category_in_view) { e; }
code_block_177 = CodeBlock { "Name(Data)"; }
getParameterValueByName_14 = Element.GetParameterValueByName(element=code_block_176, parameterName=code_block_177)
code_block_178 = CodeBlock { ["BLOCKING"]; }
eq_10 = getParameterValueByName_14@L2 == code_block_178  # lacing=CrossProduct
transpose_5 = List.Transpose(lists=eq_10@L3)
anyTrue_7 = List.AnyTrue(list=transpose_5@L2)
filterByBoolMask_13 = List.FilterByBoolMask(list=code_block_176, mask=anyTrue_7)
code_block_179 = CodeBlock { "Sublabel2(Data)"; }
getParameterValueByName_15 = Element.GetParameterValueByName(element=filterByBoolMask_13.in, parameterName=code_block_179)
code_block_180 = CodeBlock(a=getParameterValueByName_15) { a=="ROOFS"?true:false; }
filterByBoolMask_14 = List.FilterByBoolMask(list=filterByBoolMask_13.in, mask=code_block_180)
geometry_9 = Element.Geometry(element=filterByBoolMask_14.out)
flatten_23 = List.Flatten(list=geometry_9)
code_block_181 = CodeBlock(a=flatten_23) { String.Contains(DSCore.Object.Type(a), "Mesh", false); }
boolean_14 = BoolSelector(true)
allIndicesOf_16 = List.AllIndicesOf(list=code_block_181, item=boolean_14)
getItemAtIndex_18 = List.GetItemAtIndex(list=flatten_23, index=allIndicesOf_16)
code_block_182 = CodeBlock(msh=getItemAtIndex_18) { List.Flatten(MeshToCubid(msh),-1); }
replaceItemAtIndex_14 = Custom[List.ReplaceItemAtIndex+](seq=flatten_23, indices=allIndicesOf_16, replacement=code_block_182)
list_create_6 = List.Create()  # unwired: item0, item1, item2
boundingBox_6 = Element.BoundingBox(element=filterByBoolMask_14.out)
properties_6 = Custom[BoundingBox.Properties](boundingBox=boundingBox_6@L1)
combine_6 = List.Combine(combineFunction=list_create_6, list0=properties_6.Width, list1=properties_6.Depth, list2=properties_6.Height)
ꟿ_list_maxindex_6 = Custom[ꟿ List.MaxIndex](list=combine_6)
count_6 = List.Count(list=boundingBox_6@L2)
chop_6 = List.Chop(list=ꟿ_list_maxindex_6.idx, lengths=count_6)
groupByKey_8 = List.GroupByKey(list=replaceItemAtIndex_14@L2, keys=chop_6@L2)
code_block_183 = CodeBlock { 400; }
ꟿ_geometry_groupbydistance_9 = Custom[ꟿ Geometry.GroupByDistance](geometry=groupByKey_8.groups@L2, margin=code_block_183)
byUnion_9 = Solid.ByUnion(solids=ꟿ_geometry_groupbydistance_9@L2)
code_block_184 = CodeBlock(a=byUnion_9) { List.Flatten(UnalignedCuboid(a),-1); }
code_block_185 = CodeBlock(gmt=code_block_184) { List.Flatten(CenterLine(gmt),-1); }
code_block_186 = CodeBlock(line1=code_block_185, cub=code_block_184)  # same code as code_block_76
code_block_187 = CodeBlock(l=code_block_186.t5) { AglinCoordZ((List.Flatten([Line.StartPoint(l),Line.EndPoint(l)])),200); }
flatten_24 = List.Flatten(list=code_block_187)
code_block_188 = CodeBlock { 300; }
code_block_189 = CodeBlock(lin=code_block_186.t5, pnt=flatten_24, mar=code_block_188) { TransferredLine(lin, pnt, mar); }
code_block_190 = CodeBlock(s=if_, ls=replaceItemAtIndex_13) { List.Flatten([s,ls]); }
closestPointTo_10 = Geometry.ClosestPointTo(geometry=code_block_190, other=code_block_189, lacing=CrossProduct)
flatten_25 = List.Flatten(list=closestPointTo_10)
code_block_191 = CodeBlock { 500; }
code_block_192 = CodeBlock(lin=code_block_189, pnt=flatten_25, mar=code_block_191) { TransferredLine(lin, pnt, mar); }
intersect = Geometry.Intersect(geometry=code_block_192, other=code_block_190, lacing=CrossProduct)
flatten_26 = List.Flatten(list=intersect@L3)
splitByPoints = Curve.SplitByPoints(curve=code_block_192@L1, points=flatten_26@L2)
flatten_27 = List.Flatten(list=splitByPoints)
code_block_193 = CodeBlock { "Width(Geometry)"; }
getParameterValueByName_16 = Element.GetParameterValueByName(element=filterByBoolMask_14.out, parameterName=code_block_193)
minimumItem_3 = List.MinimumItem(list=getParameterValueByName_16)
code_block_194 = CodeBlock { 1000; }
code_block_195 = CodeBlock { "Height(Geometry)"; }
getParameterValueByName_17 = Element.GetParameterValueByName(element=filterByBoolMask_14.out, parameterName=code_block_195)
average = Math.Average(numbers=getParameterValueByName_17)
byLengths = Cuboid.ByLengths(width=minimumItem_3, length=code_block_194, height=average)

length_2 = Curve.Length(curve=flatten_27)
code_block_196 = CodeBlock(l=length_2) { l<150?false:true; }
filterByBoolMask_15 = List.FilterByBoolMask(list=flatten_27, mask=code_block_196)
code_block_197 = CodeBlock(a=filterByBoolMask_15.in) { a; }
code_block_198 = CodeBlock(b1=code_block_197, b2=code_block_125) { List.Flatten([b1,b2],-1); }
byCurve_3 = StructuralDesign.Model.AnalyticalModel.AnalyticalMember.ByCurve(curve=code_block_198)

# group (continued): BLOCKING
count_7 = List.Count(list=code_block_197)
cycle = List.Cycle(list=byLengths, amount=count_7)

code_block_199 = CodeBlock(b1=cycle, b2=code_block_123.t7) { List.Flatten([b1,b2],-1); }
width_3 = Cuboid.Width(cuboid=code_block_199)
round_5 = Math.Round(number=width_3)
code_block_200 = CodeBlock(dd=sort_3, tt=round_5) { NearNumber(dd,tt); }
ꟿ_number_tostring_5 = Custom[ꟿ Number.ToString](num=code_block_200)
height_3 = Cuboid.Height(cuboid=code_block_199)
round_6 = Math.Round(number=height_3)
code_block_201 = CodeBlock(dd=sort_4, tt=round_6) { NearNumber(dd,tt); }
ꟿ_number_tostring_6 = Custom[ꟿ Number.ToString](num=code_block_201)
code_block_202 = CodeBlock(b=ꟿ_number_tostring_5, d=ꟿ_number_tostring_6) { b+"x"+d; }
byName_7 = FamilyType.ByName(name=code_block_202)
setSectionType_3 = StructuralDesign.Model.AnalyticalModel.AnalyticalMember.SetSectionType(analiticalMember=byCurve_3, type=byName_7)
structural_roles_3 = StructuralRoleComboBox("Member")
setStructuralRole_3 = StructuralDesign.Model.AnalyticalModel.AnalyticalMember.SetStructuralRole(analiticalMember=byCurve_3, structuralRole=structural_roles_3)
code_block_203 = CodeBlock { "hsbCAD_PINE"; }
byName_8 = Material.ByName(name=code_block_203)
setMaterial_3 = StructuralDesign.Model.AnalyticalModel.AnalyticalMember.SetMaterial(analiticalMember=byCurve_3, material=byName_8)
code_block_204 = CodeBlock(p=code_block_138, t=code_block_150) { List.Flatten([p,t],-1); }
byCurve_4 = StructuralDesign.Model.AnalyticalModel.AnalyticalMember.ByCurve(curve=code_block_204)
code_block_205 = CodeBlock(p=code_block_48.t7, t=code_block_147.t7) { List.Flatten([p,t],-1); }
width_4 = Cuboid.Width(cuboid=code_block_205)
round_7 = Math.Round(number=width_4)
code_block_206 = CodeBlock(dd=sort_3, tt=round_7) { NearNumber(dd,tt); }
ꟿ_number_tostring_7 = Custom[ꟿ Number.ToString](num=code_block_206)
height_4 = Cuboid.Height(cuboid=code_block_205)
round_8 = Math.Round(number=height_4)
code_block_207 = CodeBlock(dd=sort_4, tt=round_8) { NearNumber(dd,tt); }
ꟿ_number_tostring_8 = Custom[ꟿ Number.ToString](num=code_block_207)
code_block_208 = CodeBlock(b=ꟿ_number_tostring_7, d=ꟿ_number_tostring_8) { b+"x"+d; }
byName_9 = FamilyType.ByName(name=code_block_208)
setSectionType_4 = StructuralDesign.Model.AnalyticalModel.AnalyticalMember.SetSectionType(analiticalMember=byCurve_4, type=byName_9)
structural_roles_4 = StructuralRoleComboBox("Beam")
setStructuralRole_4 = StructuralDesign.Model.AnalyticalModel.AnalyticalMember.SetStructuralRole(analiticalMember=byCurve_4, structuralRole=structural_roles_4)
code_block_209 = CodeBlock { "hsbCAD_PINE"; }
byName_10 = Material.ByName(name=code_block_209)
setMaterial_4 = StructuralDesign.Model.AnalyticalModel.AnalyticalMember.SetMaterial(analiticalMember=byCurve_4, material=byName_10)
code_block_210 = CodeBlock { 0.5; }
pointAtParameter_2 = Curve.PointAtParameter(curve=code_block_61, param=code_block_210)
Z_2 = Point.Z(point=pointAtParameter_2)
pointAtParameter_3 = Curve.PointAtParameter(curve=code_block_60, param=code_block_210)
Z_3 = Point.Z(point=pointAtParameter_3)
sub = Z_2 - Z_3  # lacing=CrossProduct
abs = Math.Abs(number=sub)
minimumItem_4 = List.MinimumItem(list=abs)
